vi "Training sequence preprocessing_student.gvi"   [LabVIEW NXG]
panel controls:
  "Training Sequences in": T1 = {"Length 11 Zadoff Chu 1 "=[1+0i, 1+0i, 1+0i, 0+0i, 1+0i, 1+0i, 0+0i, 1+0i, 0+0i, 0+0i, 0+0i], "Length 11 Zadoff Chu 2"=[1+0i, 0+0i, 1+0i, 1+0i, 0+0i, 1+0i, 0+0i, 0+0i, 0+0i, 1+0i, 1+0i]}
  "error in (no error)": error
panel indicators:
  "Training Sequences out": T1
  "error out": error
types:
  T1 = cluster{"Length 11 Zadoff Chu 1 ": c128[], "Length 11 Zadoff Chu 2": c128[]}
diagram:
  Property Node(instance in=$"Training Sequences in") -> ("Length 11 Zadoff Chu 1 "=w1, "Length 11 Zadoff Chu 2"=w2)
  Array Size(array=w1) -> (size(s)=w3)
  Initialize Array(element=0+0i, size=w3) -> w4
  Build Array[ConcatenateInputs=True](w4, w1, w4) -> w5
  Array Size(array=w2) -> (size(s)=w6)
  Initialize Array(element=0+0i, size=w6) -> w7
  Build Array[ConcatenateInputs=True](w7, w2, w7) -> w8
  Build Cluster(w5, w8) -> w9
  $"Training Sequences out" <- w9
  $"error out" <- $"error in (no error)"
