vi "channel_estimate_MIMO_student.gvi"   [LabVIEW NXG]
inputs:
  "Modulation Parameters In": T6 = {"Modulation Type"="QPSK", "Control Information\nfor Packet Header/Tail"={"Training Sequence 1 (derived)"=[], "Zero Pad Length"=0, "Training Sequence 2 (derived)"=[]}, "RX Oversample Factor"=20, "Synchronization Options"={"Synchronization Method"="Timing Estimation", "Fixed Offset"=0, "Symbol Timing Recovery Method"="Max Energy", "Frame Detection Method"="Sliding Correlator", "Correct Frequency Offset"=FALSE}, "Number of Data Symbols (Derived)"=250, "RX Sample Rate"=4000000, "Pulse Shaping Parameters"={"Modulation Type"="PSK", "Pulse Shaping Filter"="Raised Cosine", "Filter Parameter"=0.5, "Filter Length (Symbols)"=8}, "Channel Estimation/Equalization Parameters"={"Equalization Method"="Direct", "Channel Estimate Length"=4, "Equalizer Length"=4, "Equalizer Delay"=-1}}
  "Input Symbol Sequence 1": c128[]
  "Input Symbol Sequence 2": c128[]
  "error in (no error)": error
outputs:
  "Modulation Parameters Out": T6
  "Channel estimates": T7
  "Mean-Square Error": f64
  "error out": error
types:
  T1 = cluster{"Training Sequence 1 (derived)": c128[], "Zero Pad Length": i32, "Training Sequence 2 (derived)": c128[]}
  T2 = cluster{"Synchronization Method": string, "Fixed Offset": i32, "Symbol Timing Recovery Method": string, "Frame Detection Method": string, "Correct Frequency Offset": bool}
  T3 = enum{"none", "Raised Cosine", "Root Raised Cos", "Gaussian"}
  T4 = cluster{"Modulation Type": enum{"FSK", "PSK", "QAM", "MSK", "PAM", "ASK"}, "Pulse Shaping Filter": T3, "Filter Parameter": f64, "Filter Length (Symbols)": i32}
  T5 = cluster{"Equalization Method": string, "Channel Estimate Length": i32, "Equalizer Length": i32, "Equalizer Delay": i32}
  T6 = cluster{"Modulation Type": string, "Control Information\nfor Packet Header/Tail": T1, "RX Oversample Factor": i32, "Synchronization Options": T2, "Number of Data Symbols (Derived)": i32, "RX Sample Rate": f64, "Pulse Shaping Parameters": T4, "Channel Estimation/Equalization Parameters": T5}
  T7 = cluster{"Element 1": c128[], "Element 2": c128[], "Element 3": c128[], "Element 4": c128[]}
diagram:
  $"Modulation Parameters Out" <- $"Modulation Parameters In"
  case ($"error in (no error)") {
    frame No Error {
      # Nt
      Property Node(instance in=$"Modulation Parameters In") -> ("Control Information\nfor Packet Header/Tail:Training Sequence 1 (derived)"=w2, "Control Information\nfor Packet Header/Tail:Training Sequence 2 (derived)"=w3, "Channel Estimation/Equalization Parameters:Channel Estimate Length"=w4)
      # L
      Decrement(x=w4) -> w5
      Subtract(x=44, y=w5) -> w6
      # 87+L
      Add(87, w5) -> w7
      Array Subset(array=$"Input Symbol Sequence 1", index0=w7, length0=w6) -> w8
      # t2
      Array Subset(array=w3, index0=87, length0=44) -> w9
      Array Subset(array=w9, index0=w5, length0=w6) -> w10
      Decrement(x=w4) -> w11
      Array Subset(array=w9, index0=0, length0=w11) -> w12
      Reverse 1D Array(array=w12) -> (reversed array=w13)
      call "student_toeplitz.gvi"(Row=w13, Column=w10) -> (Toeplitz Array=w14)
      # estimate of the channel h1
      call "student_LLSE.gvi"(A=w14, b=w8) -> (x.estimate=w15, mean square error=w16)
      Array Subset(array=$"Input Symbol Sequence 2", index0=w7, length0=w6) -> w17
      # estimate of the channel h3
      call "student_LLSE.gvi"(A=w14, b=w17) -> (x.estimate=w18, mean square error=w19)
      Subtract(x=44, y=w11) -> w20
      Array Subset(array=$"Input Symbol Sequence 2", index0=w11, length0=w20) -> w21
      # L+1
      # t
      # t;0;0;0
      # Nt
      Array Subset(array=w2, index0=0, length0=44) -> w22
      Array Subset(array=w22, index0=0, length0=w11) -> w23
      # ligne
      Reverse 1D Array(array=w23) -> (reversed array=w24)
      # colonne
      Array Subset(array=w22, index0=w11, length0=w20) -> w25
      # matrix T
      call "student_toeplitz.gvi"(Row=w24, Column=w25) -> (Toeplitz Array=w26)
      # estimate of the channel h2
      call "student_LLSE.gvi"(A=w26, b=w21) -> (x.estimate=w27, mean square error=w28)
      Array Subset(array=$"Input Symbol Sequence 1", index0=w11, length0=w20) -> w29
      # estimate of the channel h0
      call "student_LLSE.gvi"(A=w26, b=w29) -> (x.estimate=w30, mean square error=w31)
      Add(w31, w28, w16, w19) -> w32
      Divide(x=w32, y=4) -> w33
      $"Mean-Square Error" <- w33
      Build Cluster(w30, w15, w27, w18) -> w34
      $"Channel estimates" <- w34
      w1 = $"error in (no error)"
    }
    frame Error {
      w1 = $"error in (no error)"
    }
  }
  $"error out" <- w1
