vi "synchronize_MIMO.gvi"   [LabVIEW NXG]
inputs:
  "Modulation Parameters In": T6 = {"Modulation Type"="QPSK", "Control Information\nfor Packet Header/Tail"={"Training Sequence 1 (derived)"=[], "Zero Pad Length"=0, "Training Sequence 2 (derived)"=[]}, "RX Oversample Factor"=20, "Synchronization Options"={"Synchronization Method"="Timing Estimation", "Fixed Offset"=0, "Symbol Timing Recovery Method"="Max Energy", "Frame Detection Method"="Sliding Correlator", "Correct Frequency Offset"=FALSE}, "Number of Data Symbols (Derived)"=250, "RX Sample Rate"=4000000, "Pulse Shaping Parameters"={"Modulation Type"="PSK", "Pulse Shaping Filter"="Raised Cosine", "Filter Parameter"=0.5, "Filter Length (Symbols)"=8}, "Channel Estimation/Equalization Parameters"={"Equalization Method"="Direct", "Channel Estimate Length"=4, "Equalizer Length"=4, "Equalizer Delay"=-1}}
  "Input Complex Waveform 1": cluster{"t0": f64, "dt": f64, "Y": c128[]}
  "Input Complex Waveform 2": cluster{"t0": f64, "dt": f64, "Y": c128[]}
  "error in (no error)": error
outputs:
  "Modulation Parameters Out": T6
  "Output Complex Symbols 1": c128[]
  "Intermediate Complex Waveform 2": cluster{"t0": f64, "dt": f64, "Y": c128[]}
  "Offset 1": i32
  "error out": error
  "Intermediate Complex Waveform 1": cluster{"t0": f64, "dt": f64, "Y": c128[]}
  "Channel Estimate 1": c128[]
  "Estimated Frequency Offset 1": f64
  "Output Complex Symbols 2": c128[]
  "Offset 2": i32
  "Estimated Frequency Offset 2": f64
  "Channel Estimate 2": c128[]
types:
  T1 = cluster{"Training Sequence 1 (derived)": c128[], "Zero Pad Length": i32, "Training Sequence 2 (derived)": c128[]}
  T2 = cluster{"Synchronization Method": string, "Fixed Offset": i32, "Symbol Timing Recovery Method": string, "Frame Detection Method": string, "Correct Frequency Offset": bool}
  T3 = enum{"none", "Raised Cosine", "Root Raised Cos", "Gaussian"}
  T4 = cluster{"Modulation Type": enum{"FSK", "PSK", "QAM", "MSK", "PAM", "ASK"}, "Pulse Shaping Filter": T3, "Filter Parameter": f64, "Filter Length (Symbols)": i32}
  T5 = cluster{"Equalization Method": string, "Channel Estimate Length": i32, "Equalizer Length": i32, "Equalizer Delay": i32}
  T6 = cluster{"Modulation Type": string, "Control Information\nfor Packet Header/Tail": T1, "RX Oversample Factor": i32, "Synchronization Options": T2, "Number of Data Symbols (Derived)": i32, "RX Sample Rate": f64, "Pulse Shaping Parameters": T4, "Channel Estimation/Equalization Parameters": T5}
diagram:
  $"Modulation Parameters Out" <- $"Modulation Parameters In"
  case ($"error in (no error)") {
    frame No Error {
      # Recover symbol timing, perform frame detection, and estimate frequency offset correction
      Property Node(instance in=$"Modulation Parameters In") -> ("Synchronization Options:Synchronization Method"=w2)
      case (w2) {
        frame "Timing Estimation" {
          call "symbol_timing_MIMO.gviprotected"(Modulation Parameters In=$"Modulation Parameters In", Input Complex Waveform=$"Input Complex Waveform 1", error in (no error)=$"error in (no error)") -> (Modulation Parameters Out=w8, Output Complex Waveform=w9, Alignment Offset=w10, error out=w11)
          Property Node(instance in=$"Modulation Parameters In") -> ("RX Oversample Factor"=w12)
          call "frame_detect_MIMO_perfectCSI.gvi"(Modulation Parameters In=w8, Input Complex Waveform=w9, error in (no error)=w11) -> (Output=w3, Frame Offset=w13, Frequency Offset=w7, error out=w4)
          Multiply(w13, w12) -> w14
          Add(w10, w14) -> w15
          To Long Integer(number=w15) -> w5
          w6 = c128[] []
        }
        frame "Fixed Offset", Default {
          call "symbol_timing_MIMO.gviprotected"(Modulation Parameters In=$"Modulation Parameters In", Input Complex Waveform=$"Input Complex Waveform 1", error in (no error)=$"error in (no error)") -> (Output Complex Waveform=w16, Alignment Offset=w17, error out=w4)
          Property Node(instance in=w16) -> ("Y"=w3)
          To Long Integer(number=w17) -> w5
          w6 = c128[] []
          w7 = 0
        }
      }
      Property Node(instance in=$"Input Complex Waveform 1") -> ("Y"=w18)
      Delete From Array(inArray=w18, length (1)=w5, index0=0) -> w19
      Property Node(instance in=$"Input Complex Waveform 1", "t0"=0, "Y"=w19) -> (instance out=w20)
      # Get intermediate waveform for eye diagram graph
      $"Intermediate Complex Waveform 1" <- w20
      $"Output Complex Symbols 1" <- w3
      $"Estimated Frequency Offset 1" <- w7
      $"Offset 1" <- w5
      $"Channel Estimate 1" <- w6
      case (w2) {
        frame "Timing Estimation" {
          call "symbol_timing_MIMO.gviprotected"(Modulation Parameters In=$"Modulation Parameters In", Input Complex Waveform=$"Input Complex Waveform 2", error in (no error)=w4) -> (Modulation Parameters Out=w25, Output Complex Waveform=w26, Alignment Offset=w27, error out=w28)
          Property Node(instance in=$"Modulation Parameters In") -> ("RX Oversample Factor"=w29)
          call "frame_detect_MIMO_perfectCSI.gvi"(Modulation Parameters In=w25, Input Complex Waveform=w26, error in (no error)=w28) -> (Output=w21, Frame Offset=w30, Frequency Offset=w24, error out=w1)
          Multiply(w30, w29) -> w31
          Add(w27, w31) -> w32
          To Long Integer(number=w32) -> w22
          w23 = c128[] []
        }
        frame "Fixed Offset", Default {
          call "symbol_timing_MIMO.gviprotected"(Modulation Parameters In=$"Modulation Parameters In", Input Complex Waveform=$"Input Complex Waveform 2", error in (no error)=w4) -> (Output Complex Waveform=w33, Alignment Offset=w34, error out=w1)
          Property Node(instance in=w33) -> ("Y"=w21)
          To Long Integer(number=w34) -> w22
          w23 = c128[] []
          w24 = 0
        }
      }
      Property Node(instance in=$"Input Complex Waveform 2") -> ("Y"=w35)
      Delete From Array(inArray=w35, length (1)=w22, index0=0) -> w36
      Property Node(instance in=$"Input Complex Waveform 2", "t0"=0, "Y"=w36) -> (instance out=w37)
      $"Intermediate Complex Waveform 2" <- w37
      $"Output Complex Symbols 2" <- w21
      $"Estimated Frequency Offset 2" <- w24
      $"Offset 2" <- w22
      $"Channel Estimate 2" <- w23
    }
    frame Error {
      w1 = $"error in (no error)"
    }
  }
  $"error out" <- w1
