vi "simulator.gvi"   [LabVIEW NXG]
panel controls:
  "# of Iterations": i32 = 1
  "Control Information for Packet Header/Tail": T1 = {"Training Sequences"="Zadoff Chu", "Zero Pad Length"=8}
  "Pulse Shaping Parameters": T3 = {"Modulation Type"="PSK", "Pulse Shaping Filter"="Raised Cosine", "Filter Parameter"=0.5, "Filter Length (Symbols)"=8}
  "Packet Length (Bits)": i32 = 500
  "RX Oversample Factor": i32 = 4
  "RX Sample Rate": f64 = 4000000
  "TX Sample Rate": f64 = 4000000
  "TX Oversample Factor": i32 = 4
  "RX HW Parameters": T4 = {"Active Antenna"="RX1", "Carrier Frequency (Hz)"=915000000, "Gain (dB)"=10, "Trigger Level"=0.01, "Bandwidth (Hz)"=915000000, "Reference Position (%)"=10, "Capture Time (s)"=0.0033, "Simulate"=FALSE, "Device IP Address"="192.168.11.2"}
  "Channel Model Parameters": T5 = {"Noise Power (dB)"=-Inf, "Channel Model"="AWGN"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}
  "TX HW Parameters": T6 = {"Active Antenna"="TX1", "Carrier Frequency (Hz)"=915000000, "Gain (dB)"=10, "Generation Mode"="Simulate", "Device IP Address"="192.168.11.3"}
  "Modulation Type": string = "QPSK"
  "Channel Estimation/Equalization Parameters": T7 = {"Equalization Method"="Direct", "Channel Estimate Length"=4, "Equalizer Length"=4, "Equalizer Delay"=-1}
  "Synchronization Options": T8 = {"Synchronization Method"="Timing Estimation", "Fixed Offset"=0, "Symbol Timing Recovery Method"="Max Energy", "Frame Detection Method"="Sliding Correlator", "Correct Frequency Offset"=FALSE}
  "Plots": i32
  "RX modulation parameters": T11 = {"Modulation Type"="QPSK", "Control Information\nfor Packet Header/Tail"={"Training Sequence 1 (derived)"=[], "Zero Pad Length"=0, "Training Sequence 2 (derived)"=[]}, "RX Oversample Factor"=20, "Synchronization Options"={"Synchronization Method"="Timing Estimation", "Fixed Offset"=0, "Symbol Timing Recovery Method"="Max Energy", "Frame Detection Method"="Sliding Correlator", "Correct Frequency Offset"=FALSE}, "Number of Data Symbols (Derived)"=250, "RX Sample Rate"=4000000, "Pulse Shaping Parameters"={"Modulation Type"="PSK", "Pulse Shaping Filter"="Raised Cosine", "Filter Parameter"=0.5, "Filter Length (Symbols)"=8}, "Channel Estimation/Equalization Parameters"={"Equalization Method"="Direct", "Channel Estimate Length"=4, "Equalizer Length"=4, "Equalizer Delay"=-1}}
  "TX modulation Parameters": T13 = {"Modulation Type"="QPSK", "Pulse Shaping Parameters"={"Modulation Type"="PSK", "Pulse Shaping Filter"="Raised Cosine", "Filter Parameter"=0.5, "Filter Length (Symbols)"=8}, "TX Oversample Factor"=20, "Packet Length (Bits)"=500, "TX Sample Rate"=4000000, "Control Information For Packet Header/Tail"={"Training Sequences "="Length 11 Barker Sequence", "Zero Pad Length"=8}}
panel indicators:
  "Average Bit-Error Rate": f64
  "Error Statistic (averaged over the two antennas)": f64
  "Estimated time Offset 1": i32
  "error out": error
  "Received Constellation": T9[]
  "Received Eye Diagram 2": cluster{"t0": f64, "dt": f64, "Y": f64[]}[]
  "Power Delay Profile h_11": waveform<f64>
  "Q Data RX 1": waveform<f64>
  "I Data RX 1": waveform<f64>
  "Received Eye Diagram 1": cluster{"t0": f64, "dt": f64, "Y": f64[]}[]
  "Power Delay Profile h_12": waveform<f64>
  "Power Delay Profile h_21": waveform<f64>
  "Power Delay Profile h_22": waveform<f64>
  "Estimated time Offset 2": i32
  "Measured channel impairements": T15
  "I Data RX 2": waveform<f64>
  "Q Data RX 2": waveform<f64>
types:
  T1 = cluster{"Training Sequences": string, "Zero Pad Length": i32}
  T2 = enum{"none", "Raised Cosine", "Root Raised Cos", "Gaussian"}
  T3 = cluster{"Modulation Type": enum{"FSK", "PSK", "QAM", "MSK", "PAM", "ASK"}, "Pulse Shaping Filter": T2, "Filter Parameter": f64, "Filter Length (Symbols)": i32}
  T4 = cluster{"Active Antenna": string, "Carrier Frequency (Hz)": f64, "Gain (dB)": f64, "Trigger Level": f64, "Bandwidth (Hz)": f64, "Reference Position (%)": f64, "Capture Time (s)": f64, "Simulate": bool, "Device IP Address": string}
  T5 = cluster{"Noise Power (dB)": f64, "Channel Response h_11": c128[], "Frequency Offset": f64, "Delay (sec)": f64, "Channel Model": string, "Channel Response h_12": c128[], "Channel Response h_21": c128[], "Channel Response h_22": c128[]}
  T6 = cluster{"Active Antenna": string, "Carrier Frequency (Hz)": f64, "Gain (dB)": f64, "Generation Mode": enum{"Single Shot", "Simulate", "Continuous"}, "Device IP Address": string}
  T7 = cluster{"Equalization Method": string, "Channel Estimate Length": i32, "Equalizer Length": i32, "Equalizer Delay": i32}
  T8 = cluster{"Synchronization Method": string, "Fixed Offset": i32, "Symbol Timing Recovery Method": string, "Frame Detection Method": string, "Correct Frequency Offset": bool}
  T9 = cluster{"constellation": f64[], "oversampled data": f64[]}
  T10 = cluster{"Training Sequence 1 (derived)": c128[], "Zero Pad Length": i32, "Training Sequence 2 (derived)": c128[]}
  T11 = cluster{"Modulation Type": string, "Control Information\nfor Packet Header/Tail": T10, "RX Oversample Factor": i32, "Synchronization Options": T8, "Number of Data Symbols (Derived)": i32, "RX Sample Rate": f64, "Pulse Shaping Parameters": T3, "Channel Estimation/Equalization Parameters": T7}
  T12 = cluster{"Training Sequences ": string, "Zero Pad Length": i32}
  T13 = cluster{"Modulation Type": string, "Pulse Shaping Parameters": T3, "TX Oversample Factor": i32, "Packet Length (Bits)": i32, "TX Sample Rate": f64, "Control Information For Packet Header/Tail": T12}
  T14 = cluster{"Estimate h_11": c128[], "Estimate h_12": c128[], "Estimate h21": c128[], "Estimate h_22": c128[]}
  T15 = cluster{"SNR(dB)": f64, "freq. offset 1": f64, "delay 1": f64, "Channel estimates": T14, "freq. offset 2": f64, "delay 2": f64}
diagram:
  w1 = $"# of Iterations"
  # actual delay
  Property Node(instance in=$"Channel Model Parameters") -> (instance out=w2, "Delay (sec)"=w3)
  Property Node(instance in=$"RX HW Parameters", "Simulate"=TRUE) -> (instance out=w4)
  Property Node(instance in=$"Control Information for Packet Header/Tail") -> ("Zero Pad Length"=w5)
  Property Node(instance in=T10 {all zero or empty}, "Zero Pad Length"=w5) -> (instance out=w6)
  # Ts
  Property Node(instance in=$"RX modulation parameters", "Modulation Type"=$"Modulation Type", "Pulse Shaping Parameters"=$"Pulse Shaping Parameters", "Control Information\nfor Packet Header/Tail"=w6, "RX Oversample Factor"=$"RX Oversample Factor", "Channel Estimation/Equalization Parameters"=$"Channel Estimation/Equalization Parameters", "Synchronization Options"=$"Synchronization Options", "RX Sample Rate"=$"RX Sample Rate") -> (instance out=w7)
  Property Node(instance in=$"TX HW Parameters", "Generation Mode"="Simulate") -> (instance out=w8)
  Property Node(instance in=$"TX modulation Parameters", "Modulation Type"=$"Modulation Type", "Pulse Shaping Parameters"=$"Pulse Shaping Parameters", "TX Oversample Factor"=$"TX Oversample Factor", "Packet Length (Bits)"=$"Packet Length (Bits)", "Control Information For Packet Header/Tail"=$"Control Information for Packet Header/Tail", "TX Sample Rate"=$"TX Sample Rate") -> (instance out=w9)
  Divide(x=$"RX Oversample Factor", y=$"RX Sample Rate") -> w10
  for (N = w1) {
    Property Node(instance in=w2) -> (instance out=w14, "Noise Power (dB)"=w15, "Delay (sec)"=w16, "Frequency Offset"=w17, "Channel Model"=w18)
    Random Number() -> (number (0 to 1)=w19)
    Random Number() -> (number (0 to 1)=w20)
    Multiply(w20, PiTimes2) -> w21
    Polar To Complex(r=w19, theta=w21) -> (r * e^(i*theta)=w22)
    Build Array(w22) -> w23
    Random Number() -> (number (0 to 1)=w24)
    Random Number() -> (number (0 to 1)=w25)
    Multiply(w25, PiTimes2) -> w26
    Polar To Complex(r=w24, theta=w26) -> (r * e^(i*theta)=w27)
    Build Array(w27) -> w28
    Random Number() -> (number (0 to 1)=w29)
    Random Number() -> (number (0 to 1)=w30)
    Multiply(w30, PiTimes2) -> w31
    Polar To Complex(r=w29, theta=w31) -> (r * e^(i*theta)=w32)
    Build Array(w32) -> w33
    Random Number() -> (number (0 to 1)=w34)
    Random Number() -> (number (0 to 1)=w35)
    Multiply(w35, PiTimes2) -> w36
    Polar To Complex(r=w34, theta=w36) -> (r * e^(i*theta)=w37)
    Build Array(w37) -> w38
    Property Node(instance in=w14, "Noise Power (dB)"=w15, "Channel Response h_11"=w33, "Frequency Offset"=w17, "Delay (sec)"=w16, "Channel Model"=w18, "Channel Response h_12"=w38, "Channel Response h_21"=w28, "Channel Response h_22"=w23) -> (instance out=w39)
    call "top_tx_MIMO.gvi"(HW Parameters=w8, Modulation Parameters=w9) -> (error out=w40, Output IQ Waveform 1=w41, Output IQ Waveform 2=w42)
    # IQ Waveforms
    call "top_rx_MIMO.gvi"(error in=w40, IQ Waveform 1=w41, HW Parameters=w4, RX Modulation Parameters=w7, IQ Waveform 2=w42, Channel Model Parameters=w39) -> (Eye Diagram 1=w43, Average Bit-Error Rate=w44, I Data RX 1=w45, Q Data RX 1=w46, Measured channel impairements=w47, I Data RX 2=w48, Eye Diagram 2=w49, error out=w50, Estimated Time Offset 1=w51, Power Delay Profile h_11=w52, Q Data RX 2=w53, Power Delay Profile h_12=w54, Power Delay Profile h_21=w55, Power Delay Profile h_22=w56, Estimated Time Offset 2=w57, Signal Constellation=w58)
    Property Node(instance in=w47) -> ("delay 1"=w59, "delay 2"=w60)
    Subtract(x=w3, y=w59) -> w61
    Divide(x=w61, y=w10) -> w62
    Square(x=w62) -> w63
    Subtract(x=w3, y=w60) -> w64
    Divide(x=w64, y=w10) -> w65
    Square(x=w65) -> w66
    $"Measured channel impairements" <- w47
    $"Received Constellation" <- w58
    $"I Data RX 1" <- w45
    $"Q Data RX 1" <- w46
    $"I Data RX 2" <- w48
    $"Q Data RX 2" <- w53
    $"Received Eye Diagram 1" <- w43
    $"Received Eye Diagram 2" <- w49
    $"error out" <- w50
    $"Estimated time Offset 1" <- w51
    $"Estimated time Offset 2" <- w57
    $"Power Delay Profile h_11" <- w52
    $"Power Delay Profile h_12" <- w54
    $"Power Delay Profile h_21" <- w55
    $"Power Delay Profile h_22" <- w56
    append w44 to w11
    append w63 to w12
    append w66 to w13
  }
  call "Mean (DBL).gvi"(X=w12) -> (mean=w67)
  call "Mean (DBL).gvi"(X=w13) -> (mean=w68)
  Add(w67, w68) -> w69
  Divide(x=w69, y=2) -> w70
  $"Error Statistic (averaged over the two antennas)" <- w70
  call "Mean (DBL).gvi"(X=w11) -> (mean=w71)
  $"Average Bit-Error Rate" <- w71
