vi "student_sliding_correlator.gvi"   [LabVIEW NXG]
inputs:
  "Modulation Parameters In": T6 = {"Modulation Type"="QPSK", "Control Information\nfor Packet Header/Tail"={"Training Sequence 1 (derived)"=[], "Zero Pad Length"=0, "Training Sequence 2 (derived)"=[]}, "RX Oversample Factor"=20, "Synchronization Options"={"Synchronization Method"="Timing Estimation", "Fixed Offset"=0, "Symbol Timing Recovery Method"="Max Energy", "Frame Detection Method"="Sliding Correlator", "Correct Frequency Offset"=FALSE}, "Number of Data Symbols (Derived)"=250, "RX Sample Rate"=4000000, "Pulse Shaping Parameters"={"Modulation Type"="PSK", "Pulse Shaping Filter"="Raised Cosine", "Filter Parameter"=0.5, "Filter Length (Symbols)"=8}, "Channel Estimation/Equalization Parameters"={"Equalization Method"="Direct", "Channel Estimate Length"=4, "Equalizer Length"=4, "Equalizer Delay"=-1}}
  "Input Complex Waveform": cluster{"t0": f64, "dt": f64, "Y": c128[]} = {"t0"=0, "dt"=1, "Y"=[]}
  "error in (no error)": error
outputs:
  "Output": c128[]
  "Frame Offset": i32
  "Frequency Offset": f64
  "error out": error
types:
  T1 = cluster{"Training Sequence 1 (derived)": c128[], "Zero Pad Length": i32, "Training Sequence 2 (derived)": c128[]}
  T2 = cluster{"Synchronization Method": string, "Fixed Offset": i32, "Symbol Timing Recovery Method": string, "Frame Detection Method": string, "Correct Frequency Offset": bool}
  T3 = enum{"none", "Raised Cosine", "Root Raised Cos", "Gaussian"}
  T4 = cluster{"Modulation Type": enum{"FSK", "PSK", "QAM", "MSK", "PAM", "ASK"}, "Pulse Shaping Filter": T3, "Filter Parameter": f64, "Filter Length (Symbols)": i32}
  T5 = cluster{"Equalization Method": string, "Channel Estimate Length": i32, "Equalizer Length": i32, "Equalizer Delay": i32}
  T6 = cluster{"Modulation Type": string, "Control Information\nfor Packet Header/Tail": T1, "RX Oversample Factor": i32, "Synchronization Options": T2, "Number of Data Symbols (Derived)": i32, "RX Sample Rate": f64, "Pulse Shaping Parameters": T4, "Channel Estimation/Equalization Parameters": T5}
diagram:
  # t
  # Nt
  Property Node(instance in=$"Modulation Parameters In") -> ("Control Information\nfor Packet Header/Tail:Training Sequence 1 (derived)"=w1, "Control Information\nfor Packet Header/Tail:Zero Pad Length"=w2, "Synchronization Options:Correct Frequency Offset"=w3)
  # y
  Property Node(instance in=$"Input Complex Waveform") -> ("Y"=w4)
  Array Size(array=w4) -> (size(s)=w5)
  Complex Conjugate(x + iy=w1) -> w6
  # boucle sur n
  for (N = w2) (iteration -> i1) {
    # boucle sur k
    for (N = w2) (iteration -> i2) {
      Array Index(array=w6) -> (out0[i2]=w9)
      Add(i1, i2) -> w10
      Array Index(array=w4) -> (out0[w10]=w11)
      Multiply(w11, w9) -> w12
      append w12 to w8
    }
    Add Array Elements(numeric array=w8) -> (sum=w13)
    Absolute Value(x=w13) -> w14
    Square(x=w14) -> w15
    append w15 to w7
  }
  Array Max And Min(array=w7) -> (max index(es)=w16)
  Subtract(x=w5, y=w16) -> w17
  Decrement(x=w17) -> w18
  Array Subset(array=w4, index0=w18) -> w19
  case (w3) {
    frame False, Default {
      call "student_moose.gvi"(Modulation Parameters In=$"Modulation Parameters In", Input=w19) -> (Frequency Offset=w21)
      w20 = w19
    }
    frame True {
      call "student_moose.gvi"(Modulation Parameters In=$"Modulation Parameters In", Input=w19) -> (Output=w20, Frequency Offset=w21)
    }
  }
  $Output <- w20
  $"Frequency Offset" <- w21
  Subtract(x=w18, y=w2) -> w22
  $"Frame Offset" <- w22
  $"error out" <- $"error in (no error)"
